# Grasshopper definition ToRevit - Energy Unit.gh (Grasshopper 1.0.7)
# plug-ins: Speckle 2, Rhino.Inside for Autodesk Revit

panel = Panel("https://macad.speckle.xyz/streams/fb56d94596/branches/aggregation-units-attribute%2Fcirc%20units%20attributes")
receive = Receive(
    Stream=panel,
    AutoReceive=False,
    CurrentComponentState="expired",
    ExpandOutput=True,
    LastInfoMessage="James Foo @ 3/2/2024 3:26:37 AM: UPDATED CIRC/ENERGY UNIT (id:a8c66966b5)",
    ReceiveOnOpen=False,
    ReceivedCommitId="a8c66966b5",
    StreamWrapper="https://macad.speckle.xyz/streams/fb56d94596/branches/aggregation-units-attribute/circ units attributes",
    selectedKitName="Objects")  # -> Info, Data
dso = DeconstructSpeckleObject(SpeckleObject=receive.Data, selectedKitName="Objects")  # -> BEAMS, PANELS, VERTICALCONNECTION, WALLS

dso_2 = DeconstructSpeckleObject(SpeckleObject=dso.BEAMS, selectedKitName="Objects")  # -> BEAMBASECURVE, BEAMS
type = Type(
    <familysymbol referenced from the Revit model>,
    SelectedBuiltInCategory="autodesk.revit.category.family:structuralFraming")
s_beam = AddStructuralBeam(Curve=dso_2.BEAMBASECURVE, Type=type, TrackingMode=2)
parameters = QueryElementParameters(Element=type)
value_picker = ValuePicker(parameters)
param = ElementParameter(Element=type, Parameter=value_picker, Value=Slider(30, range=0..100))  # -> Element, Value

dso_3 = DeconstructSpeckleObject(SpeckleObject=dso.PANELS, selectedKitName="Objects")  # -> FlatPanel, InflatedPanel, PanelBoundary
material = AddMaterial(Name="ETFE", TrackingMode=2)
g_shape = AddGeometryDirectShape(
    Name="INFLATED PANELS",
    Category=<geometry referenced from the Revit model>,
    Geometry=dso_3.InflatedPanel,
    Material=material,
    TrackingMode=2)

cir = Circle(Plane=PlaneXY(0, 0, 0), Radius=Slider(1000, range=0..10000))
level = Level(<level referenced from the Revit model>)
level_2 = Level(<level referenced from the Revit model>)
shaft = AddShaftOpening(Boundary=cir, Base=level, Top=level_2, TrackingMode=2)

dso_4 = DeconstructSpeckleObject(SpeckleObject=dso.VERTICALCONNECTION, selectedKitName="Objects")  # -> VERTICALCONNECTIONBOUNDARY, VERTICALCONNECTIONS
geo = Geometry(dso_4.VERTICALCONNECTIONBOUNDARY)
end = EndPoints(Curve=geo)  # -> Start, End
avr = Average(Input=end.End)
project = Project(Geometry=dso_4.VERTICALCONNECTIONBOUNDARY, Plane=avr)  # -> Geometry, Transform
Z = UnitZ(Factor=Slider(300, range=0..1000))
join = JoinCurves(Curves=project.Geometry, Preserve=False)
move = Move(Geometry=join, Motion=Z)  # -> Geometry, Transform
floor = AddFloor(Boundary=move.Geometry, Type=<hostobjecttype referenced from the Revit model>, Structural=True, TrackingMode=2)

dso_5 = DeconstructSpeckleObject(SpeckleObject=dso.WALLS, selectedKitName="Objects")  # -> WALLPROFILE, WALLS
wallprfl = AddWallProfile(Profile=dso_5.WALLPROFILE, TrackingMode=2)

number_slider = Slider(150, range=0..1000)

bang = ExplodeTree(Data=dso_4.VERTICALCONNECTIONBOUNDARY)  # -> Branch0, Branch1
explode = Explode(Curve=bang.Branch0, Recursive=True)  # -> Segments, Vertices
explode_2 = Explode(Curve=bang.Branch1, Recursive=True)  # -> Segments, Vertices
midpt = CurveMiddle(Curve=explode.Segments)
midpt_2 = CurveMiddle(Curve=explode_2.Segments)
avr_2 = Average(Input=midpt)
avr_3 = Average(Input=midpt_2)
ln = Line(StartPoint=avr_2, EndPoint=avr_3)
type_2 = Type(
    <familysymbol referenced from the Revit model>,
    SelectedBuiltInCategory="autodesk.revit.category.family:structuralFraming")
s_beam_2 = AddStructuralBeam(Curve=ln, Type=type_2, TrackingMode=2)

Z_2 = UnitZ(Factor=number_slider)

number_slider_2 = Slider(-900, range=-1500..1500)
mjoin = MeshJoin(Meshes=flatten(dso_3.FlatPanel))
pt = ConstructPoint(XCoordinate=0, YCoordinate=0, ZCoordinate=number_slider_2)
sec = MeshPlane(Mesh=mjoin, Plane=pt)

addition = Addition(A=number_slider_2, B=number_slider)

medges = MeshEdges(Mesh=mjoin)  # -> NakedEdges, InteriorEdges, NonManifoldEdges
demesh = DeconstructMesh(Mesh=mjoin)  # -> Vertices, Faces, Colours, Normals
merge = Merge(Data1=medges.NakedEdges, Data2=medges.InteriorEdges)
bbox = BoundingBox(Content=demesh.Vertices, Plane=PlaneXY(0, 0, 0), UnionBox=True)  # -> Box, Box_2
pdecon = Deconstruct(Point=demesh.Vertices)  # -> XComponent, YComponent, ZComponent
midpt_3 = CurveMiddle(Curve=merge)
rec = Rectangle(bbox.Box)
larger = LargerThan(FirstNumber=pdecon.ZComponent, SecondNumber="-.01")  # -> LargerThan, OrEqualTo
pdecon_2 = Deconstruct(Point=midpt_3)  # -> XComponent, YComponent, ZComponent
roof = AddRoof(Boundary=rec, Type=<hostobjecttype referenced from the Revit model>, TrackingMode=2)
cull = CullPattern(List=demesh.Vertices, CullPattern=larger.OrEqualTo)
larger_2 = LargerThan(FirstNumber=pdecon_2.ZComponent, SecondNumber="-.01")  # -> LargerThan, OrEqualTo
cull_2 = CullPattern(List=merge, CullPattern=larger_2.OrEqualTo)
h_shape = HostShape(Host=roof, Points=cull, Creases=cull_2)  # -> Host, Exteriors, Interiors

move_2 = Move(Geometry=sec, Motion=Z_2)  # -> Geometry, Transform

level_3 = AddLevel(Elevation=addition, Name="1.5 TOP OF FLOOR", TrackingMode=2)
floor_2 = AddFloor(Boundary=move_2.Geometry, Type=<hostobjecttype referenced from the Revit model>, Structural=True, TrackingMode=2)
