# Grasshopper definition ToRevit - Link Placer.gh (Grasshopper 1.0.7)
# plug-ins: Speckle 2, Pufferfish, Rhino.Inside for Autodesk Revit

# ---- group: PHASE 1
panel = Panel("https://macad.speckle.xyz/projects/fb56d94596/models/d220a4bb66")
receive = Receive(
    Stream=panel,
    AutoReceive=False,
    CurrentComponentState="up_to_date",
    ExpandOutput=True,
    LastInfoMessage="James Foo @ 03/19/2024 04:28:12: Pushed 151 elements from Grasshopper. (id:798b98ce43)",
    ReceiveOnOpen=False,
    ReceivedCommitId="798b98ce43",
    StreamWrapper="https://macad.speckle.xyz/streams/fb56d94596/branches/d220a4bb66",
    selectedKitName="Objects")  # -> Info, Data
dso = DeconstructSpeckleObject(SpeckleObject=receive.Data, selectedKitName="Objects")  # -> LARGEUNITS, SMALLUNITS
dso_2 = DeconstructSpeckleObject(SpeckleObject=dso.LARGEUNITS, selectedKitName="Objects")  # -> flatten(CENTER), flatten(GEOMETRY)
dso_3 = DeconstructSpeckleObject(SpeckleObject=dso.SMALLUNITS, selectedKitName="Objects")  # -> flatten(CENTER), flatten(GEOMETRY)
entwine = Entwine(Branch00=dso_2.CENTER, Branch01=dso_3.CENTER, FlattenInputs=True)
entwine_2 = Entwine(Branch00=dso_2.GEOMETRY, Branch01=dso_3.GEOMETRY, FlattenInputs=True)

# ---- group: PHASE 2
panel_2 = Panel("https://macad.speckle.xyz/projects/fb56d94596/models/339c3c5f35")
receive_2 = Receive(
    Stream=panel_2,
    AutoReceive=False,
    CurrentComponentState="up_to_date",
    ExpandOutput=True,
    LastInfoMessage="James Foo @ 03/19/2024 04:28:26: Pushed 375 elements from Grasshopper. (id:f886e9657b)",
    ReceiveOnOpen=False,
    ReceivedCommitId="f886e9657b",
    StreamWrapper="https://macad.speckle.xyz/streams/fb56d94596/branches/339c3c5f35",
    selectedKitName="Objects")  # -> Info, Data
dso_4 = DeconstructSpeckleObject(SpeckleObject=receive_2.Data, selectedKitName="Objects")  # -> LARGEUNITS, SMALLUNITS
dso_5 = DeconstructSpeckleObject(SpeckleObject=dso_4.LARGEUNITS, selectedKitName="Objects")  # -> flatten(CENTER), flatten(GEOMETRY)
dso_6 = DeconstructSpeckleObject(SpeckleObject=dso_4.SMALLUNITS, selectedKitName="Objects")  # -> flatten(CENTER), flatten(GEOMETRY)
entwine_3 = Entwine(Branch00=dso_5.CENTER, Branch01=dso_6.CENTER, FlattenInputs=True)
entwine_4 = Entwine(Branch00=dso_5.GEOMETRY, Branch01=dso_6.GEOMETRY, FlattenInputs=True)

# ---- group: PHASE 3
panel_3 = Panel("https://macad.speckle.xyz/projects/fb56d94596/models/b83aba3451")
receive_3 = Receive(
    Stream=panel_3,
    AutoReceive=False,
    CurrentComponentState="up_to_date",
    ExpandOutput=True,
    LastInfoMessage="James Foo @ 03/19/2024 04:28:34: Pushed 731 elements from Grasshopper. (id:9425f3c435)",
    ReceiveOnOpen=False,
    ReceivedCommitId="9425f3c435",
    StreamWrapper="https://macad.speckle.xyz/streams/fb56d94596/branches/b83aba3451",
    selectedKitName="Objects")  # -> Info, Data
dso_7 = DeconstructSpeckleObject(SpeckleObject=receive_3.Data, selectedKitName="Objects")  # -> LARGEUNITS, SMALLUNITS
dso_8 = DeconstructSpeckleObject(SpeckleObject=dso_7.LARGEUNITS, selectedKitName="Objects")  # -> flatten(CENTER), flatten(GEOMETRY)
dso_9 = DeconstructSpeckleObject(SpeckleObject=dso_7.SMALLUNITS, selectedKitName="Objects")  # -> flatten(CENTER), flatten(GEOMETRY)
entwine_5 = Entwine(Branch00=dso_8.CENTER, Branch01=dso_9.CENTER, FlattenInputs=True)
entwine_6 = Entwine(Branch00=dso_8.GEOMETRY, Branch01=dso_9.GEOMETRY, FlattenInputs=True)

# ----
panel_4 = Panel("https://macad.speckle.xyz/projects/4975f9f0a8/models/ad03ead215")
receive_4 = Receive(
    Stream=panel_4,
    AutoReceive=False,
    CurrentComponentState="expired",
    ExpandOutput=True,
    LastInfoMessage="James McBennett @ 01/19/2024 01:12:11: Pushed 7 elements from Grasshopper. (id:290330322f)",
    ReceiveOnOpen=False,
    ReceivedCommitId="290330322f",
    StreamWrapper="https://macad.speckle.xyz/streams/4975f9f0a8/branches/ad03ead215",
    selectedKitName="Objects")  # -> Info, CollectionType, Elements, Info_2, Name, Types
dso_10 = DeconstructSpeckleObject(SpeckleObject=receive_4.Elements, selectedKitName="Objects")  # -> CollectionType, Elements, Name
dso_11 = DeconstructSpeckleObject(SpeckleObject=dso_10.Elements, selectedKitName="Objects")  # -> BaseGeometry, BuiltInCategory, Category, DisplayValue, ElementId, IsRevitLinkedModel, MaterialQuantities, Parameters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
neg = Negative(Value=Slider(0, range=0..1000))
X = UnitX(Factor=Slider(0, range=0..1000))
Y = UnitY(Factor=neg)
addition = Addition(A=X, B=Y)
move = Move(Geometry=entwine, Motion=addition)  # -> Geometry, Transform
move_2 = Move(Geometry=entwine_2, Motion=addition)  # -> Geometry, Transform
move_3 = Move(Geometry=entwine_3, Motion=addition)  # -> Geometry, Transform
move_4 = Move(Geometry=entwine_4, Motion=addition)  # -> Geometry, Transform
move_5 = Move(Geometry=entwine_5, Motion=addition)  # -> Geometry, Transform
move_6 = Move(Geometry=entwine_6, Motion=addition)  # -> Geometry, Transform

cp = ClosestPoint(Point=move_3.Geometry, Cloud=move.Geometry)  # -> ClosestPoint, CPIndex, Distance
equalst = EqualityWithinTolerance(FirstNumber=cp.Distance, SecondNumber="0", Tolerance=0.0005233832795)  # -> Equality, Inequality
cull = CullPattern(List=move_3.Geometry, CullPattern=equalst.Inequality)
cull_2 = CullPattern(List=move_4.Geometry, CullPattern=equalst.Inequality)

cp_2 = ClosestPoint(Point=move_5.Geometry, Cloud=move_3.Geometry)  # -> ClosestPoint, CPIndex, Distance
equalst_2 = EqualityWithinTolerance(FirstNumber=cp_2.Distance, SecondNumber="0", Tolerance=0.0005233832795)  # -> Equality, Inequality
cull_3 = CullPattern(List=move_5.Geometry, CullPattern=equalst_2.Inequality)
cull_4 = CullPattern(List=move_6.Geometry, CullPattern=equalst_2.Inequality)

links = QueryRevitLinks()  # -> Links, Documents
item = ListItem(List=links.Links, Index=0, Wrap=True)  # -> Item, Item1, Item2, Item3, Item4, Item5

geo = Geometry(cull_3)
geo_2 = Geometry(cull_4)
geo_3 = Geometry(cull_2)
geo_4 = Geometry(move.Geometry)
geo_5 = Geometry(move_2.Geometry)
geo_6 = Geometry(cull)

bang = ExplodeTree(Data=geo_4)  # -> Branch0, Branch1
bang_2 = ExplodeTree(Data=geo_5)  # -> Branch0, Branch1

bang_3 = ExplodeTree(Data=geo_6)  # -> Branch0, Branch1
bang_4 = ExplodeTree(Data=geo_3)  # -> Branch0, Branch1

bang_5 = ExplodeTree(Data=geo)  # -> Branch0, Branch1
bang_6 = ExplodeTree(Data=geo_2)  # -> Branch0, Branch1

rr_phase_2 = Element(<revitlinkinstance referenced from the Revit model>)
en_phase_2 = Element(<revitlinkinstance referenced from the Revit model>)

# ---- group: ENERGY UNIT
en_phase_1 = Element(<revitlinkinstance referenced from the Revit model>)

# ---- group: RES/REC UNIT
rr_phase_1 = Element(<revitlinkinstance referenced from the Revit model>)

# ----
en_phase_3 = Element(<revitlinkinstance referenced from the Revit model>)
rr_phase_3 = Element(<revitlinkinstance referenced from the Revit model>)

res_rec = Geometry(bang.Branch0)
energy = Geometry(bang.Branch1)
geo_7 = Geometry(bang_2.Branch0)
geo_8 = Geometry(bang_2.Branch1)
res_rec_2 = Geometry(bang_3.Branch0)
energy_2 = Geometry(bang_3.Branch1)
geo_9 = Geometry(bang_4.Branch0)
geo_10 = Geometry(bang_4.Branch1)
res_rec_3 = Geometry(bang_5.Branch0)
energy_3 = Geometry(bang_5.Branch1)
geo_11 = Geometry(bang_6.Branch0)
geo_12 = Geometry(bang_6.Branch1)

clone = CloneElement(Element=rr_phase_1, Location=res_rec, TrackingMode=2)
clone_2 = CloneElement(Element=en_phase_1, Location=energy, TrackingMode=2)
merge = Merge(Data1=clone, Data2=clone_2)
parameter = Parameter(<parameter referenced from the Revit model>, SelectedBuiltInCategory="autodesk.revit.category.local:rvtLinks")
param = ElementParameter(Element=merge, Parameter=parameter, Value="PHASE 1")  # -> Element, Value

clone_3 = CloneElement(Element=rr_phase_2, Location=res_rec_2, TrackingMode=2)
clone_4 = CloneElement(Element=en_phase_2, Location=energy_2, TrackingMode=2)
merge_2 = Merge(Data1=clone_3, Data2=clone_4)
parameter_2 = Parameter(<parameter referenced from the Revit model>, SelectedBuiltInCategory="autodesk.revit.category.local:rvtLinks")
param_2 = ElementParameter(Element=merge_2, Parameter=parameter_2, Value="PHASE 2")  # -> Element, Value

clone_5 = CloneElement(Element=rr_phase_3, Location=res_rec_3, TrackingMode=2)
clone_6 = CloneElement(Element=en_phase_3, Location=energy_3, TrackingMode=2)
merge_3 = Merge(Data1=clone_5, Data2=clone_6)
parameter_3 = Parameter(<parameter referenced from the Revit model>, SelectedBuiltInCategory="autodesk.revit.category.local:rvtLinks")
param_3 = ElementParameter(Element=merge_3, Parameter=parameter_3, Value="PHASE 3")  # -> Element, Value
