# Grasshopper definition ToRevit - Residential [Speckle].gh (Grasshopper 1.0.7)
# plug-ins: Speckle 2

panel = Panel("https://macad.speckle.xyz/streams/4975f9f0a8/branches/site%2F05-materials")
panel_2 = Panel("https://macad.speckle.xyz/streams/fb56d94596/branches/aggregation-units-attribute%2Flarger%20units%20attributes")
receive = Receive(
    Stream=panel,
    AutoReceive=False,
    CurrentComponentState="up_to_date",
    ExpandOutput=True,
    LastInfoMessage="James McBennett @ 03/02/2024 01:57:29: Materials 01-03-2024 (id:6ecf38526e)",
    ReceiveOnOpen=False,
    ReceivedCommitId="6ecf38526e",
    StreamWrapper="https://macad.speckle.xyz/streams/4975f9f0a8/branches/site/05-materials",
    selectedKitName="Objects")  # -> Info, Materials
dso = DeconstructSpeckleObject(SpeckleObject=receive.Materials, selectedKitName="Objects")  # -> Glass, Inflatable, Insulation, Mineral, Regolith, Site, Soil, Steel
receive_2 = Receive(
    Stream=panel_2,
    AutoReceive=False,
    CurrentComponentState="expired",
    ExpandOutput=True,
    LastInfoMessage="James Foo @ 03/10/2024 23:54:55: UPDATED RESIDENTIAL/RECREATION UNIT (id:1e291453b4)",
    ReceiveOnOpen=False,
    ReceivedCommitId="1e291453b4",
    StreamWrapper="https://macad.speckle.xyz/streams/fb56d94596/branches/aggregation-units-attribute/larger units attributes",
    selectedKitName="Objects")  # -> Info, Data
dso_2 = DeconstructSpeckleObject(SpeckleObject=receive_2.Data, selectedKitName="Objects")  # -> BEAMS, PANELS, SOLARCONNECTIONPOINTS, VERTICALCONNECTION, WALLS

dso_3 = DeconstructSpeckleObject(SpeckleObject=dso_2.BEAMS, selectedKitName="Objects")  # -> BEAMBASECURVE, BEAMS
parameter = Parameter(
    Name="Beam Radius",
    Value=Slider(30, range=0..100),
    SelectedConstructorName="Objects.BuiltElements.Revit.Parameter.ctor(System.String,System.Object,System.String)",
    SelectedTypeName="Objects.BuiltElements.Revit.Parameter",
    UseSchemaTag=False,
    UserSetSchemaTag=False,
    seed="76dcfbc3f54044649929")
revitlevel_by_name = RevitLevelByName(
    Name="LEVEL 2 - CENTER",
    SelectedConstructorName="Objects.BuiltElements.Revit.RevitLevel.ctor(System.String)",
    SelectedTypeName="Objects.BuiltElements.Revit.RevitLevel",
    UseSchemaTag=False,
    UserSetSchemaTag=False,
    seed="adc4aa740602abcf9546")
revitbeam = RevitBeam(
    Family="Aluminum Framing",
    Type="30mm",
    BaseLine=dso_3.BEAMBASECURVE,
    Level=revitlevel_by_name,
    Parameters=parameter,
    SelectedConstructorName="Objects.BuiltElements.Revit.RevitBeam.ctor(System.String,System.String,Objects.ICurve,Objects.BuiltElements.Level,System.Collections.Generic.List`1[Objects.BuiltElements.Revit.Parameter])",
    SelectedTypeName="Objects.BuiltElements.Revit.RevitBeam",
    UseSchemaTag=False,
    UserSetSchemaTag=False,
    seed="281538c10c51972efbdd")

dso_4 = DeconstructSpeckleObject(SpeckleObject=dso_2.PANELS, selectedKitName="Objects")  # -> FlatPanel, InflatedPanel, PanelBoundary
panel_3 = Panel("ETFE")
category = Category({"AbutmentFoundations": 0, "AbutmentPiles": 1, "AbutmentWalls": 2, "Alignments": 5, "ApproachSlabs": 7, "AudioVisualDevices": 9, "BridgeAbutments": 3, "BridgeArches": 8, "BridgeBearings": 11, "BridgeCables": 13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}, selected="CurtainWallPanels": 27)
directshape_by_base_geometries = DirectShapeByBaseGeometries(
    Name="INFLATED PANELS",
    Category=category,
    BaseGeometries=dso_4.InflatedPanel,
    SelectedConstructorName="Objects.BuiltElements.Revit.DirectShape.ctor(System.String,Objects.BuiltElements.Revit.RevitCategory,System.Collections.Generic.List`1[Speckle.Core.Models.Base],System.Collections.Generic.List`1[Objects.BuiltElements.Revit.Parameter])",
    SelectedTypeName="Objects.BuiltElements.Revit.DirectShape",
    UseSchemaTag=False,
    UserSetSchemaTag=False,
    seed="0f6c964e61919a78bffa")

cir = Circle(Plane=PlaneXY(0, 0, 0), Radius=Slider(1000, range=0..10000))

number_slider = Slider(-900, range=-1500..1500)
panel_4 = Panel("1.5 TOP OF FLOOR")
mjoin = MeshJoin(Meshes=flatten(dso_4.FlatPanel))
pt = ConstructPoint(XCoordinate=0, YCoordinate=0, ZCoordinate=Slider(-0.8, range=-1.5..1.5))
sec = MeshPlane(Mesh=mjoin, Plane=pt)

dso_5 = DeconstructSpeckleObject(SpeckleObject=dso_2.WALLS, selectedKitName="Objects")  # -> WALLPROFILE, WALLS
locationline = LocationLine({"Centerline": 0, "Exterior": 1, "Interior": 2}, selected="Centerline")
revitlevel_by_name_2 = RevitLevelByName(
    Name="1.5 TOP OF FLOOR",
    SelectedConstructorName="Objects.BuiltElements.Revit.RevitLevel.ctor(System.String)",
    SelectedTypeName="Objects.BuiltElements.Revit.RevitLevel",
    UseSchemaTag=False,
    UserSetSchemaTag=False,
    seed="c309ad6e6883bc9393f3")
revitwall_by_profile = RevitWallByProfile(
    Family="Basic Wall",
    Type="Insulated Aluminum - 120mm",
    Profile=dso_5.WALLPROFILE,
    Level=revitlevel_by_name_2,
    LocationLine=locationline,
    Structural=False,
    SelectedConstructorName="Objects.BuiltElements.Revit.RevitProfileWall.ctor(System.String,System.String,Objects.Geometry.Polycurve,Objects.BuiltElements.Level,Objects.BuiltElements.Revit.LocationLine,System.Boolean,System.Collections.Generic.List`1[Speckle.Core.Models.Base],System.Collections.Generic.List`1[Objects.BuiltElements.Revit.Parameter])",
    SelectedTypeName="Objects.BuiltElements.Revit.RevitProfileWall",
    UseSchemaTag=False,
    UserSetSchemaTag=False,
    seed="413b2da5b123db8901d4")

dso_6 = DeconstructSpeckleObject(SpeckleObject=dso_2.VERTICALCONNECTION, selectedKitName="Objects")  # -> VERTICALCONNECTIONBOUNDARY, VERTICALCONNECTIONS
geo = Geometry(dso_6.VERTICALCONNECTIONBOUNDARY)
end = EndPoints(Curve=geo)  # -> Start, End
avr = Average(Input=end.End)
project = Project(Geometry=dso_6.VERTICALCONNECTIONBOUNDARY, Plane=avr)  # -> Geometry, Transform
Z = UnitZ(Factor=Slider(0.15, range=0..1))
join = JoinCurves(Curves=project.Geometry, Preserve=False)
move = Move(Geometry=join, Motion=Z)  # -> Geometry, Transform
revitlevel_by_name_3 = RevitLevelByName(
    Name="LEVEL 2 - CENTER",
    SelectedConstructorName="Objects.BuiltElements.Revit.RevitLevel.ctor(System.String)",
    SelectedTypeName="Objects.BuiltElements.Revit.RevitLevel",
    UseSchemaTag=False,
    UserSetSchemaTag=False,
    seed="fde33eb2e1785dadd902")
revitfootprintroof = RevitFootprintRoof(
    Outline=move.Geometry,
    Family="Floor",
    Type="Insulated Aluminum - 320mm",
    Level=revitlevel_by_name_3,
    Slope=0,
    SelectedConstructorName="Objects.BuiltElements.Revit.RevitRoof.RevitFootprintRoof.ctor(Objects.ICurve,System.String,System.String,Objects.BuiltElements.Level,Objects.BuiltElements.Revit.RevitLevel,System.Double,System.Collections.Generic.List`1[Objects.ICurve],System.Collections.Generic.List`1[Speckle.Core.Models.Base],System.Collections.Generic.List`1[Objects.BuiltElements.Revit.Parameter])",
    SelectedTypeName="Objects.BuiltElements.Revit.RevitRoof.RevitFootprintRoof",
    UseSchemaTag=False,
    UserSetSchemaTag=False,
    seed="e44a97f07f375bf2cecb")  # -> simplify(RevitFootprintRoof)

medges = MeshEdges(Mesh=mjoin)  # -> NakedEdges, InteriorEdges, NonManifoldEdges
demesh = DeconstructMesh(Mesh=mjoin)  # -> Vertices, Faces, Colours, Normals
merge = Merge(Data1=medges.NakedEdges, Data2=medges.InteriorEdges)
project_2 = Project(Geometry=demesh.Vertices, Plane=PlaneXY(0, 0, 0))  # -> Geometry, Transform
pdecon = Deconstruct(Point=demesh.Vertices)  # -> XComponent, YComponent, ZComponent
midpt = CurveMiddle(Curve=merge)
larger = LargerThan(FirstNumber=pdecon.ZComponent, SecondNumber="-.01")  # -> LargerThan, OrEqualTo
pdecon_2 = Deconstruct(Point=midpt)  # -> XComponent, YComponent, ZComponent
cull = CullPattern(List=demesh.Vertices, CullPattern=larger.OrEqualTo)
larger_2 = LargerThan(FirstNumber=pdecon_2.ZComponent, SecondNumber="-.01")  # -> LargerThan, OrEqualTo
hull = ConvexHull(Points=project_2.Geometry, Plane=PlaneXY(0, 0, 0))  # -> Hull, HullZ, Indices
cull_2 = CullPattern(List=merge, CullPattern=larger_2.OrEqualTo)

data = Data(dso.Inflatable)
cso = CreateSpeckleObject(Panels=directshape_by_base_geometries, Material=data, selectedKitName="Objects")
merge_2 = Merge(Data1=cull, Data2=cull_2)
revitlevel_by_name_4 = RevitLevelByName(
    Name="LEVEL 2 - CENTER",
    SelectedConstructorName="Objects.BuiltElements.Revit.RevitLevel.ctor(System.String)",
    SelectedTypeName="Objects.BuiltElements.Revit.RevitLevel",
    UseSchemaTag=False,
    UserSetSchemaTag=False,
    seed="5e6418a37209ea436d4b")

bang = ExplodeTree(Data=dso_6.VERTICALCONNECTIONBOUNDARY)  # -> Branch0, Branch1
explode = Explode(Curve=bang.Branch0, Recursive=True)  # -> Segments, Vertices
explode_2 = Explode(Curve=bang.Branch1, Recursive=True)  # -> Segments, Vertices
midpt_2 = CurveMiddle(Curve=explode.Segments)
midpt_3 = CurveMiddle(Curve=explode_2.Segments)
avr_2 = Average(Input=midpt_2)
avr_3 = Average(Input=midpt_3)
ln = Line(StartPoint=avr_2, EndPoint=avr_3)

disc = Discontinuity(Curve=join, Level=1)  # -> simplify(Points), Parameters
bang_2 = ExplodeTree(Data=disc.Points)  # -> Branch0, Branch1
pdecon_3 = Deconstruct(Point=bang_2.Branch0)  # -> XComponent, YComponent, ZComponent
pdecon_4 = Deconstruct(Point=bang_2.Branch1)  # -> XComponent, YComponent, ZComponent
subtraction = Subtraction(A=pdecon_3.ZComponent, B=pdecon_4.ZComponent)
abs = Absolute(Value=subtraction)
Z_2 = UnitZ(Factor=abs)
move_2 = Move(Geometry=bang_2.Branch0, Motion=Z_2)  # -> Geometry, Transform
ln_2 = Line(StartPoint=bang_2.Branch0, EndPoint=move_2.Geometry)
parameter_2 = Parameter(
    Name="Beam Radius",
    Value=Slider(30, range=0..100),
    SelectedConstructorName="Objects.BuiltElements.Revit.Parameter.ctor(System.String,System.Object,System.String)",
    SelectedTypeName="Objects.BuiltElements.Revit.Parameter",
    UseSchemaTag=False,
    UserSetSchemaTag=False,
    seed="c788a3dda0eeddfe96b0")
revitlevel_by_name_5 = RevitLevelByName(
    Name="LEVEL 2 - CENTER",
    SelectedConstructorName="Objects.BuiltElements.Revit.RevitLevel.ctor(System.String)",
    SelectedTypeName="Objects.BuiltElements.Revit.RevitLevel",
    UseSchemaTag=False,
    UserSetSchemaTag=False,
    seed="7a84bcd4a09986e22005")
revitbeam_2 = RevitBeam(
    Family="Aluminum Framing",
    Type="30mm",
    BaseLine=flatten([ln_2, ln]),
    Level=revitlevel_by_name_5,
    Parameters=parameter_2,
    SelectedConstructorName="Objects.BuiltElements.Revit.RevitBeam.ctor(System.String,System.String,Objects.ICurve,Objects.BuiltElements.Level,System.Collections.Generic.List`1[Objects.BuiltElements.Revit.Parameter])",
    SelectedTypeName="Objects.BuiltElements.Revit.RevitBeam",
    UseSchemaTag=False,
    UserSetSchemaTag=False,
    seed="fe3becd183194f56f5ef")

revitfootprintroof_2 = RevitFootprintRoof(
    Outline=hull.Hull,
    Family="Basic Roof",
    Type="Aluminum - 10mm",
    Level=revitlevel_by_name_4,
    Slope=0,
    Elements=merge_2,
    SelectedConstructorName="Objects.BuiltElements.Revit.RevitRoof.RevitFootprintRoof.ctor(Objects.ICurve,System.String,System.String,Objects.BuiltElements.Level,Objects.BuiltElements.Revit.RevitLevel,System.Double,System.Collections.Generic.List`1[Objects.ICurve],System.Collections.Generic.List`1[Speckle.Core.Models.Base],System.Collections.Generic.List`1[Objects.BuiltElements.Revit.Parameter])",
    SelectedTypeName="Objects.BuiltElements.Revit.RevitRoof.RevitFootprintRoof",
    UseSchemaTag=False,
    UserSetSchemaTag=False,
    seed="c5942a9f033bfded9440")
so = SpeckleObject(flatten(revitwall_by_profile))
so_2 = SpeckleObject(flatten(cso))
so_3 = SpeckleObject(revitfootprintroof_2)
so_4 = SpeckleObject(revitbeam_2)
so_5 = SpeckleObject(flatten(revitfootprintroof))
cso_2 = CreateSpeckleObject(BEAMS=so_2, ROOF=so_3, COLUMNS=so_4, VERTICALCONNECTION=so_5, WALLS=so, selectedKitName="Objects")
panel_5 = Panel("https://macad.speckle.xyz/projects/fb56d94596/models/428a2dc3b9")
send = Send(
    Stream=panel_5,
    Data=cso_2,
    AutoSend=False,
    BaseId="758b47f582a51e02b5aa24e497d8f835",
    CurrentComponentState="up_to_date",
    KitName="Objects",
    OutputWrappers="https://macad.speckle.xyz\tfb56d94596\t7878bfbf9b",
    UseDefaultCache=True,
    selectedKitName="Objects")
