# Grasshopper definition ToRevit - Unfolded Solar.gh (Grasshopper 1.0.7)
# plug-ins: Speckle 2, Rhino.Inside for Autodesk Revit

panel = Panel("https://macad.speckle.xyz/streams/fb56d94596/branches/aggregation-units-attribute%2Fsolar%20units%20attributes%2Funfolded")
receive = Receive(
    Stream=panel,
    AutoReceive=False,
    CurrentComponentState="expired",
    ExpandOutput=True,
    LastInfoMessage="James Foo @ 03/05/2024 01:57:17: UNFOLDED SOLAR UNIT (id:1941a78d3a)",
    ReceiveOnOpen=False,
    ReceivedCommitId="1941a78d3a",
    StreamWrapper="https://macad.speckle.xyz/streams/fb56d94596/branches/aggregation-units-attribute/solar units attributes/unfolded",
    selectedKitName="Objects")  # -> Info, Data
dso = DeconstructSpeckleObject(SpeckleObject=receive.Data, selectedKitName="Objects")  # -> AGGREGATIONPOINT, AGGREGATIONSHAPE, BEAMS, CONNECTIONTUBE, PROTECTIVESHELL, RAILS, SOLARPANELS

dso_2 = DeconstructSpeckleObject(SpeckleObject=dso.SOLARPANELS, selectedKitName="Objects")  # -> PANELS, STRUCTURE, STRUCTURECURVES
type = Type(
    <familysymbol referenced from the Revit model>,
    SelectedBuiltInCategory="autodesk.revit.category.family:structuralFraming")
medges = MeshEdges(Mesh=dso_2.STRUCTURE)  # -> NakedEdges, InteriorEdges, NonManifoldEdges
s_beam = AddStructuralBeam(Curve=dso_2.STRUCTURECURVES, Type=type, TrackingMode=2)

# ---- group: SUPPORTS
dso_3 = DeconstructSpeckleObject(SpeckleObject=dso.BEAMS, selectedKitName="Objects")  # -> BEAMCURVE, BEAMS
type_2 = Type(
    <familysymbol referenced from the Revit model>,
    SelectedBuiltInCategory="autodesk.revit.category.family:structuralFraming")
s_beam_2 = AddStructuralBeam(Curve=dso_3.BEAMCURVE, Type=type_2, TrackingMode=2)

# ---- group: PROTECTIVE SHELL
debrep = DeconstructBrep(Brep=dso.PROTECTIVESHELL)  # -> Faces, Edges, Vertices
type_3 = Type(<familysymbol referenced from the Revit model>, SelectedBuiltInCategory="autodesk.revit.category.family:genericModel")
a_component = AddComponentAdaptive(Points=debrep.Vertices, Type=type_3, TrackingMode=2)

# ---- group: SUPPORT TUBE
debrep_2 = DeconstructBrep(Brep=dso.CONNECTIONTUBE)  # -> Faces, Edges, Vertices
number_slider = Slider(180, range=0..1000)
item = ListItem(List=debrep_2.Edges, Index="1", Wrap=True)
bbox = BoundingBox(Content=dso.CONNECTIONTUBE, Plane=PlaneXY(0, 0, 0))  # -> Box, Box_2
area = Area(Geometry=item)  # -> Area, Centroid
debox = DeconstructBox(Box=bbox.Box)  # -> Plane, X, Y, Z
neg = Negative(Value=number_slider)
merge = Merge(Data1=number_slider, Data2=neg)
num = Number(debox.X)
num_2 = Number(debox.Z)
expression = Expression(x=num, Expression="x/2")
rad = Radians(Degrees=merge)
type_4 = Type(<hostobjecttype referenced from the Revit model>, SelectedBuiltInCategory="autodesk.revit.category.local:walls")
arc = Arc(Plane=area.Centroid, Radius=expression, Angle=rad)  # -> Arc, Length
wallcrv = AddWallCurve(Curve=arc.Arc, Type=type_4, Level=null, Height=num_2, TrackingMode=2)

# ---- group: RAIL
debrep_3 = DeconstructBrep(Brep=dso.RAILS)  # -> Faces, Edges, Vertices
item_2 = ListItem(List=debrep_3.Faces, Index="3", Wrap=True)
edges = BrepEdges(Brep=item_2)  # -> Naked, Interior, NonManifold
floor = AddFloor(Boundary=edges.Naked, Type=<hostobjecttype referenced from the Revit model>, Structural=True, TrackingMode=2)

# ----
g_shape = AddGeometryDirectShape(Name="SOLAR PANELS", Category=<geometry referenced from the Revit model>, Geometry=dso_2.PANELS, TrackingMode=2)
